# Grasshopper definition building measurement.gh (Grasshopper 0.9.80)

community_center = Brep([<brep referenced from the Rhino model> x2])
kindergarden = Brep([<brep referenced from the Rhino model> x9])
primary_school = Brep([<brep referenced from the Rhino model> x10])
residential = Brep([<brep referenced from the Rhino model> x955])
sport = Brep(<brep referenced from the Rhino model>)
mikve = Brep(<brep referenced from the Rhino model>)
highshchool = Brep([<brep referenced from the Rhino model> x2])
synagogue = Brep([<brep referenced from the Rhino model> x6])
hospital = Brep([<brep referenced from the Rhino model> x2])
elderly_center = Brep(<brep referenced from the Rhino model>)
police = Brep([<brep referenced from the Rhino model> x2])
clinic = Brep([<brep referenced from the Rhino model> x4])
calculate_data = CalculateData(C=residential, B=residential, G=residential)  # -> height, area, location
calculate_data_2 = CalculateData(C=kindergarden, B=kindergarden, G=kindergarden)  # -> height, area, location
calculate_data_3 = CalculateData(C=mikve, B=mikve, G=mikve)  # -> height, area, location
calculate_data_4 = CalculateData(C=primary_school, B=primary_school, G=primary_school)  # -> height, area, location
calculate_data_5 = CalculateData(C=synagogue, B=synagogue, G=synagogue)  # -> height, area, location
calculate_data_6 = CalculateData(C=hospital, B=hospital, G=hospital)  # -> height, area, location
calculate_data_7 = CalculateData(C=community_center, B=community_center, G=community_center)  # -> height, area, location
calculate_data_8 = CalculateData(C=highshchool, B=highshchool, G=highshchool)  # -> height, area, location
calculate_data_9 = CalculateData(C=sport, B=sport, G=sport)  # -> height, area, location
calculate_data_10 = CalculateData(C=police, B=police, G=police)  # -> height, area, location
calculate_data_11 = CalculateData(C=elderly_center, B=elderly_center, G=elderly_center)  # -> height, area, location
calculate_data_12 = CalculateData(C=clinic, B=clinic, G=clinic)  # -> height, area, location
panel = Panel(calculate_data.height)
panel_2 = Panel(calculate_data.area)
panel_3 = Panel(calculate_data.location)
panel_4 = Panel(calculate_data_5.height)
panel_5 = Panel(calculate_data_5.area)
panel_6 = Panel(calculate_data_5.location)
panel_7 = Panel(calculate_data_3.height)
panel_8 = Panel(calculate_data_3.area)
panel_9 = Panel(calculate_data_3.location)
panel_10 = Panel(calculate_data_2.height)
panel_11 = Panel(calculate_data_2.area)
panel_12 = Panel(calculate_data_2.location)
panel_13 = Panel(calculate_data_9.height)
panel_14 = Panel(calculate_data_9.area)
panel_15 = Panel(calculate_data_9.location)
panel_16 = Panel(calculate_data_7.height)
panel_17 = Panel(calculate_data_7.location)
panel_18 = Panel(calculate_data_7.area)
panel_19 = Panel(calculate_data_4.height)
panel_20 = Panel(calculate_data_4.area)
panel_21 = Panel(calculate_data_4.location)
panel_22 = Panel(calculate_data_10.height)
panel_23 = Panel(calculate_data_10.area)
panel_24 = Panel(calculate_data_10.location)
panel_25 = Panel(calculate_data_6.height)
panel_26 = Panel(calculate_data_8.height)
panel_27 = Panel(calculate_data_6.area)
panel_28 = Panel(calculate_data_6.location)
panel_29 = Panel(calculate_data_8.area)
panel_30 = Panel(calculate_data_8.location)
panel_31 = Panel(calculate_data_12.height)
panel_32 = Panel(calculate_data_12.area)
panel_33 = Panel(calculate_data_12.location)
panel_34 = Panel(calculate_data_11.height)
panel_35 = Panel(calculate_data_11.area)
panel_36 = Panel(calculate_data_11.location)
project = Project(Geometry=residential, Plane=PlaneXY(0, 0, 0))  # -> Geometry, Transform
project_2 = Project(Geometry=kindergarden, Plane=PlaneXY(0, 0, 0))  # -> Geometry, Transform
project_3 = Project(Geometry=sport, Plane=PlaneXY(0, 0, 0))  # -> Geometry, Transform
project_4 = Project(Geometry=mikve, Plane=PlaneXY(0, 0, 0))  # -> Geometry, Transform
project_5 = Project(Geometry=primary_school, Plane=PlaneXY(0, 0, 0))  # -> Geometry, Transform
project_6 = Project(Geometry=highshchool, Plane=PlaneXY(0, 0, 0))  # -> Geometry, Transform
project_7 = Project(Geometry=synagogue, Plane=PlaneXY(0, 0, 0))  # -> Geometry, Transform
project_8 = Project(Geometry=hospital, Plane=PlaneXY(0, 0, 0))  # -> Geometry, Transform
project_9 = Project(Geometry=community_center, Plane=PlaneXY(0, 0, 0))  # -> Geometry, Transform
project_10 = Project(Geometry=police, Plane=PlaneXY(0, 0, 0))  # -> Geometry, Transform
project_11 = Project(Geometry=elderly_center, Plane=PlaneXY(0, 0, 0))  # -> Geometry, Transform
project_12 = Project(Geometry=clinic, Plane=PlaneXY(0, 0, 0))  # -> Geometry, Transform
debrep = DeconstructBrep(Brep=project_8.Geometry)  # -> Faces, simplify(Edges), simplify(Vertices)
debrep_2 = DeconstructBrep(Brep=project_3.Geometry)  # -> Faces, simplify(Edges), simplify(Vertices)
debrep_3 = DeconstructBrep(Brep=project_5.Geometry)  # -> Faces, simplify(Edges), simplify(Vertices)
debrep_4 = DeconstructBrep(Brep=project_9.Geometry)  # -> Faces, simplify(Edges), simplify(Vertices)
debrep_5 = DeconstructBrep(Brep=project_4.Geometry)  # -> Faces, simplify(Edges), simplify(Vertices)
debrep_6 = DeconstructBrep(Brep=project.Geometry)  # -> Faces, simplify(Edges), simplify(Vertices)
debrep_7 = DeconstructBrep(Brep=project_2.Geometry)  # -> Faces, simplify(Edges), simplify(Vertices)
debrep_8 = DeconstructBrep(Brep=project_6.Geometry)  # -> Faces, simplify(Edges), simplify(Vertices)
debrep_9 = DeconstructBrep(Brep=project_10.Geometry)  # -> Faces, simplify(Edges), simplify(Vertices)
debrep_10 = DeconstructBrep(Brep=project_11.Geometry)  # -> Faces, simplify(Edges), simplify(Vertices)
debrep_11 = DeconstructBrep(Brep=project_7.Geometry)  # -> Faces, simplify(Edges), simplify(Vertices)
debrep_12 = DeconstructBrep(Brep=project_12.Geometry)  # -> Faces, simplify(Edges), simplify(Vertices)
len = Length(Curve=debrep.Edges)
len_2 = Length(Curve=debrep_2.Edges)
len_3 = Length(Curve=debrep_3.Edges)
len_4 = Length(Curve=debrep_4.Edges)
len_5 = Length(Curve=debrep_5.Edges)
len_6 = Length(Curve=debrep_6.Edges)
len_7 = Length(Curve=debrep_7.Edges)
len_8 = Length(Curve=debrep_8.Edges)
len_9 = Length(Curve=debrep_9.Edges)
len_10 = Length(Curve=debrep_10.Edges)
len_11 = Length(Curve=debrep_11.Edges)
len_12 = Length(Curve=debrep_12.Edges)
larger = LargerThan(FirstNumber=len, SecondNumber=0.001)  # -> LargerThan, OrEqualTo
larger_2 = LargerThan(FirstNumber=len_2, SecondNumber=0.001)  # -> LargerThan, OrEqualTo
larger_3 = LargerThan(FirstNumber=len_3, SecondNumber=0.001)  # -> LargerThan, OrEqualTo
larger_4 = LargerThan(FirstNumber=len_4, SecondNumber=0.001)  # -> LargerThan, OrEqualTo
larger_5 = LargerThan(FirstNumber=len_5, SecondNumber=0.001)  # -> LargerThan, OrEqualTo
larger_6 = LargerThan(FirstNumber=len_6, SecondNumber=0.001)  # -> LargerThan, OrEqualTo
larger_7 = LargerThan(FirstNumber=len_7, SecondNumber=0.001)  # -> LargerThan, OrEqualTo
larger_8 = LargerThan(FirstNumber=len_8, SecondNumber=0.001)  # -> LargerThan, OrEqualTo
larger_9 = LargerThan(FirstNumber=len_9, SecondNumber=0.001)  # -> LargerThan, OrEqualTo
larger_10 = LargerThan(FirstNumber=len_10, SecondNumber=0.001)  # -> LargerThan, OrEqualTo
larger_11 = LargerThan(FirstNumber=len_11, SecondNumber=0.001)  # -> LargerThan, OrEqualTo
larger_12 = LargerThan(FirstNumber=len_12, SecondNumber=0.001)  # -> LargerThan, OrEqualTo
cull = CullPattern(List=debrep.Edges, CullPattern=larger.OrEqualTo)
cull_2 = CullPattern(List=debrep_2.Edges, CullPattern=larger_2.OrEqualTo)
cull_3 = CullPattern(List=debrep_3.Edges, CullPattern=larger_3.OrEqualTo)
cull_4 = CullPattern(List=debrep_4.Edges, CullPattern=larger_4.OrEqualTo)
cull_5 = CullPattern(List=debrep_5.Edges, CullPattern=larger_5.OrEqualTo)
cull_6 = CullPattern(List=debrep_6.Edges, CullPattern=larger_6.OrEqualTo)
cull_7 = CullPattern(List=debrep_7.Edges, CullPattern=larger_7.OrEqualTo)
cull_8 = CullPattern(List=debrep_8.Edges, CullPattern=larger_8.OrEqualTo)
cull_9 = CullPattern(List=debrep_9.Edges, CullPattern=larger_9.OrEqualTo)
cull_10 = CullPattern(List=debrep_10.Edges, CullPattern=larger_10.OrEqualTo)
cull_11 = CullPattern(List=debrep_11.Edges, CullPattern=larger_11.OrEqualTo)
cull_12 = CullPattern(List=debrep_12.Edges, CullPattern=larger_12.OrEqualTo)
lng = ListLength(List=cull)
lng_2 = ListLength(List=cull_2)
lng_3 = ListLength(List=cull_3)
lng_4 = ListLength(List=cull_4)
lng_5 = ListLength(List=cull_5)
lng_6 = ListLength(List=cull_6)
lng_7 = ListLength(List=cull_7)
lng_8 = ListLength(List=cull_8)
lng_9 = ListLength(List=cull_9)
lng_10 = ListLength(List=cull_10)
lng_11 = ListLength(List=cull_11)
lng_12 = ListLength(List=cull_12)
division = Division(A=lng, B=2)
division_2 = Division(A=lng_2, B=2)
division_3 = Division(A=lng_3, B=2)
division_4 = Division(A=lng_4, B=2)
division_5 = Division(A=lng_5, B=2)
division_6 = Division(A=lng_6, B=2)
division_7 = Division(A=lng_7, B=2)
division_8 = Division(A=lng_8, B=2)
division_9 = Division(A=lng_9, B=2)
division_10 = Division(A=lng_10, B=2)
division_11 = Division(A=lng_11, B=2)
division_12 = Division(A=lng_12, B=2)
subtraction = Subtraction(A=division, B=1)
subtraction_2 = Subtraction(A=division_2, B=1)
subtraction_3 = Subtraction(A=division_3, B=1)
subtraction_4 = Subtraction(A=division_4, B=1)
subtraction_5 = Subtraction(A=division_5, B=1)
subtraction_6 = Subtraction(A=division_6, B=1)
subtraction_7 = Subtraction(A=division_7, B=1)
subtraction_8 = Subtraction(A=division_8, B=1)
subtraction_9 = Subtraction(A=division_9, B=1)
subtraction_10 = Subtraction(A=division_10, B=1)
subtraction_11 = Subtraction(A=division_11, B=1)
subtraction_12 = Subtraction(A=division_12, B=1)
dom = ConstructDomain(DomainStart=0, DomainEnd=subtraction)
dom_2 = ConstructDomain(DomainStart=0, DomainEnd=subtraction_2)
dom_3 = ConstructDomain(DomainStart=0, DomainEnd=subtraction_3)
dom_4 = ConstructDomain(DomainStart=0, DomainEnd=subtraction_4)
dom_5 = ConstructDomain(DomainStart=0, DomainEnd=subtraction_5)
dom_6 = ConstructDomain(DomainStart=0, DomainEnd=subtraction_6)
dom_7 = ConstructDomain(DomainStart=0, DomainEnd=subtraction_7)
dom_8 = ConstructDomain(DomainStart=0, DomainEnd=subtraction_8)
dom_9 = ConstructDomain(DomainStart=0, DomainEnd=subtraction_9)
dom_10 = ConstructDomain(DomainStart=0, DomainEnd=subtraction_10)
dom_11 = ConstructDomain(DomainStart=0, DomainEnd=subtraction_11)
dom_12 = ConstructDomain(DomainStart=0, DomainEnd=subtraction_12)
subset = SubList(List=cull, Domain=dom, Wrap=True)  # -> List, Index
subset_2 = SubList(List=cull_2, Domain=dom_2, Wrap=True)  # -> flatten(List), Index
subset_3 = SubList(List=cull_3, Domain=dom_3, Wrap=True)  # -> List, Index
subset_4 = SubList(List=cull_4, Domain=dom_4, Wrap=True)  # -> List, Index
subset_5 = SubList(List=cull_5, Domain=dom_5, Wrap=True)  # -> flatten(List), Index
subset_6 = SubList(List=cull_6, Domain=dom_6, Wrap=True)  # -> List, Index
subset_7 = SubList(List=cull_7, Domain=dom_7, Wrap=True)  # -> List, Index
subset_8 = SubList(List=cull_8, Domain=dom_8, Wrap=True)  # -> List, Index
subset_9 = SubList(List=cull_9, Domain=dom_9, Wrap=True)  # -> List, Index
subset_10 = SubList(List=cull_10, Domain=dom_10, Wrap=True)  # -> flatten(List), Index
subset_11 = SubList(List=cull_11, Domain=dom_11, Wrap=True)  # -> List, Index
subset_12 = SubList(List=cull_12, Domain=dom_12, Wrap=True)  # -> List, Index
path_mapper = PathMapper(subset.List, source="{A;B}", target="{A}")
path_mapper_2 = PathMapper(subset_3.List, source="{A;B}", target="{A}")
path_mapper_3 = PathMapper(subset_4.List, source="{A;B}", target="{A}")
path_mapper_4 = PathMapper(subset_9.List, source="{A;B}", target="{A}")
path_mapper_5 = PathMapper(subset_6.List, source="{A;B}", target="{A}")
path_mapper_6 = PathMapper(subset_8.List, source="{A;B}", target="{A}")
path_mapper_7 = PathMapper(subset_7.List, source="{A;B}", target="{A}")
path_mapper_8 = PathMapper(subset_12.List, source="{A;B}", target="{A}")
path_mapper_9 = PathMapper(subset_11.List, source="{A;B}", target="{A}")
end = EndPoints(Curve=subset_2.List)  # -> Start, End
end_2 = EndPoints(Curve=subset_5.List)  # -> Start, End
end_3 = EndPoints(Curve=subset_10.List)  # -> Start, End
panel_37 = Panel(end.Start)
panel_38 = Panel(end.End)
panel_39 = Panel(end_2.Start)
panel_40 = Panel(end_2.End)
end_4 = EndPoints(Curve=path_mapper)  # -> Start, End
end_5 = EndPoints(Curve=path_mapper_2)  # -> Start, End
end_6 = EndPoints(Curve=path_mapper_3)  # -> Start, End
end_7 = EndPoints(Curve=path_mapper_5)  # -> Start, End
panel_41 = Panel(end_3.Start)
panel_42 = Panel(end_3.End)
end_8 = EndPoints(Curve=path_mapper_7)  # -> Start, End
end_9 = EndPoints(Curve=path_mapper_6)  # -> Start, End
end_10 = EndPoints(Curve=path_mapper_4)  # -> Start, End
end_11 = EndPoints(Curve=path_mapper_9)  # -> Start, End
end_12 = EndPoints(Curve=path_mapper_8)  # -> Start, End
panel_43 = Panel(end_4.Start)
panel_44 = Panel(end_4.End)
panel_45 = Panel(end_5.Start)
panel_46 = Panel(end_5.End)
panel_47 = Panel(end_6.Start)
panel_48 = Panel(end_6.End)
panel_49 = Panel(end_10.Start)
panel_50 = Panel(end_10.End)
panel_51 = Panel(end_7.Start)
panel_52 = Panel(end_7.End)
panel_53 = Panel(end_9.Start)
panel_54 = Panel(end_9.End)
panel_55 = Panel(end_8.Start)
panel_56 = Panel(end_8.End)
panel_57 = Panel(end_12.Start)
panel_58 = Panel(end_12.End)
panel_59 = Panel(end_11.Start)
panel_60 = Panel(end_11.End)

# ==== cluster CalculateData
G = ClusterInput()
B = ClusterInput()
C = ClusterInput()
project = Project(Geometry=G, Plane=PlaneXY(0, 0, 0))  # -> Geometry, Transform
edges = BrepEdges(Brep=B)  # -> Naked, Interior, NonManifold
bbox = BoundingBox(Content=C, Plane=PlaneXY(0, 0, 0))  # -> Box, Box_2
Z = UnitZ(Factor=1)
box = EvaluateBox(Box=bbox.Box, UParameter=0.5, VParameter=0.5, WParameter=0.5)  # -> Plane, Point, Include
line = LineSDL(Start=box.Point, Direction=Z, Length=Slider(100, range=0..100))
split = SplitWithBreps(Curve=line, Brep=bbox.Box)  # -> Curve, Points
item = ListItem(List=split.Curve, Index=0, Wrap=True)
len = Length(Curve=item)
building_height = Multiplication(A=len, B=2)  # -> flatten(Result)
building_area = Area(Geometry=project.Geometry)  # -> Area, Centroid
area = ClusterOutput(building_area.Area)
location = ClusterOutput(building_area.Centroid)
height = ClusterOutput(building_height)
